# Grasshopper definition Splatypus_Workflow.gh (Grasshopper 1.0.8)
# plug-ins: Splatypus

# ----
# TOOLS — REQUIRED
# Provide valid FFmpeg, COLMAP and Brush executable paths.
# Alternatively, click Download on Download Tools.
# Wait until Ready = True.
# Existing valid installations are reused.
# 
# On Windows, enable CUDA when using a compatible NVIDIA GPU.
# Use the CPU option for COLMAP otherwise.
# Brush requires a compatible graphics device.
button = Button()
sp_download_tools = SPDownloadTools(COLMAPCUDA=True, Download=button, Cancel=Button(), ShowTerminal=Toggle(True))  # -> FFmpeg, COLMAP, Brush, Ready, Versions, Status, LogFile
panel = Panel(sp_download_tools.Status)

# ---- group: Project Root
# SPLATYPUS — WORKFLOW GUIDE
# Create a project → Import media → Reconstruct with COLMAP → Prepare a dataset → Train → Preview.
# 
# REQUIRED steps produce the trained model.
# OPTIONAL steps provide checks, alignment or viewing.
# If a step is already complete, reuse its outputs.
# RERUNNING THE WORKFLOW
# After changing images or reconstruction settings,
# rerun the affected steps and regenerate downstream outputs.
# After changing alignment, write the model again,
# prepare the dataset again and retrain.
# Use a new project or training job name to keep separate results.
# 00 Path
# Choose the parent folder for your project.
# Use a separate project folder for each dataset.
path = FilePath()

# ----
enter_a_project_name = Panel("")
# 01 Setup
# PROJECT — REQUIRED
# Set a Parent Folder and Project Name.
# Set Create = True to create the project folders.
# Connect the project’s Root output to downstream Root inputs.
# Use a separate project for each dataset.
sp_hello = SPHello(Message="Ready")
sp_project = SPProject(ParentFolder=path, ProjectName=enter_a_project_name, Create=Toggle(False))  # -> ProjectRoot, Images, COLMAP, Brush, Status
# COMMON OPTIONS
# 
# Replace:
# Enable only when intentionally replacing a component’s
# previous output. Leave False for a first run.
# Terminal:
# Shows live processing information.
# Viewer:
# Opens Brush’s interactive training viewer.
# Cancel:
# Stops the current operation where available.
# Completed downloads, imported images or exported
# training checkpoints may remain.
panel_2 = Panel(sp_hello)
panel_3 = Panel(sp_project.Status)

# ----
# COLMAP All in One
# 
# For a new reconstruction, keep Extract, Match and Sparse enabled.
# Export is enabled by default to refresh the readable model.
# Undistort is optional and disabled by default.
# 
# Click Run once.
# Selected stages run automatically in the correct order.
# Wait for successful completion before alignment or training.
# 
# Terminal opens one window for the entire sequence.
# Progress shows completed stages, not remaining time.
# Cancel stops the current stage and skips later stages.
# Earlier successful stages remain applied.
# 
# Disable stages only when their required results already exist.
toggle = BooleanToggle(True)
# Choose one workflow for COLMAP:
# use COLMAP All for the complete sequence, or use the individual components step by step. You do not need both. Never run both on the same project simultaneously.
# 
# All-in-one: fewer clicks, automatic stage order, combined logs and cancellation. However, it does not pause for inspection between stages; a failure stops subsequent processing.
# Step by step: easier to inspect, adjust and troubleshoot individual stages. However, it requires more manual actions and careful sequencing.
# Both use the same COLMAP processing. All-in-one saves interaction rather than inherently improving speed or quality.
# 03 COLMAP
# COLMAP Step by Step— RUN IN THIS ORDER
# 
# SETUP — REQUIRED
# Set Prepare = True.
# Check that Valid = True before continuing.
# 
# EXTRACT FEATURES — REQUIRED
# Switch Run from False to True.
# Wait for successful completion.
# This finds recognisable features in the images.
# 
# MATCH FEATURES — REQUIRED
# Switch Run from False to True.
# Wait for successful completion.
# This finds corresponding features between images.
# 
# SPARSE RECONSTRUCTION — REQUIRED
# Switch Run from False to True.
# Wait for successful completion.
# This calculates camera positions and a sparse 3D point cloud.
# 
# UNDISTORT IMAGES — OPTIONAL
# This replaces the active images and camera model together.
# The corrected dataset can then be aligned.
# No separate dataset connection is needed.
# 
# 
# EXPORT MODEL — REQUIRED
# Switch Run from False to True.
# Wait for successful completion.
# The exported Text model is used for Rhino previews and
# realignment.
toggle_2 = BooleanToggle(False)
sp_colmap = SPCOLMAPSetup(COLMAPExecutable=sp_download_tools.COLMAP, ProjectRoot=sp_project.ProjectRoot, Prepare=toggle_2)  # -> Valid, Database, FeatureCommand, Status
sp_extract = SPCOLMAPFeatureExtract(
    COLMAPExecutable=sp_download_tools.COLMAP,
    ProjectRoot=sp_project.ProjectRoot,
    Run=Toggle(False),
    ShowTerminal=Toggle(True))  # -> Database, ExitCode, Log, Status
sp_match = SPCOLMAPExhaustiveMatch(
    COLMAPExecutable=sp_download_tools.COLMAP,
    ProjectRoot=sp_project.ProjectRoot,
    Run=Toggle(False),
    ShowTerminal=Toggle(True))  # -> Database, ExitCode, Log, Status
sp_sparse = SPCOLMAPSparseReconstruct(
    COLMAPExecutable=sp_download_tools.COLMAP,
    ProjectRoot=sp_project.ProjectRoot,
    Run=Toggle(False),
    ReplaceExisting=Toggle(True),
    ShowTerminal=Toggle(True))  # -> ActiveDataset, ExitCode, Log, Status
sp_undistort = SPCOLMAPUndistortImages(
    COLMAPExecutable=sp_download_tools.COLMAP,
    ActiveDataset=sp_project.ProjectRoot,
    Run=Toggle(False),
    ShowTerminal=Toggle(True))  # -> ActiveDataset, ExitCode, Log, Status
sp_export = SPCOLMAPExportModel(COLMAPExecutable=sp_download_tools.COLMAP, ProjectRoot=sp_project.ProjectRoot, Run=Toggle(False), ShowTerminal=toggle)  # -> ActiveDataset, ExitCode, Log, Status
# 04 Realignment
# 04 REALIGNMENT — OPTIONAL
# 
# Connect the active Dataset to SP Sparse Point Cloud
# and SP Camera Planes.
# 
# Pass their geometry through SP Geometry Translator.
# 
# Adjust position, rotation and uniform scale.
# 
# Connect Transforms to SP Align COLMAP Model → Xforms.
# 
# Connect the COLMAP executable and active Dataset.
# 
# Release the Data Dam, if present, then click Write.
# 
# Write saves a separate aligned model and preserves the base.
# Every write starts from the same current base model.
# Repeated writes do not accumulate transformations.
# 
# Keep the BASE Dataset connected to the source previews.
# Keep your transformation settings when refining the alignment.
# Changing the preview alone does not update the saved model.
# 
# To inspect the saved result, connect Aligned Text Model
# to separate point-cloud and camera preview components.
# 
# After another reconstruction or undistortion,
# click Write again before training with the aligned model.
panel_4 = Panel(sp_colmap.Status)
panel_5 = Panel(sp_extract.Status)
panel_6 = Panel(sp_match.Status)
panel_7 = Panel(sp_sparse.Status)
panel_8 = Panel(sp_undistort.Status)
panel_9 = Panel(sp_export.Status)

sp_colmap_all = SPCOLMAPPipeline(
    COLMAPExecutable=sp_download_tools.COLMAP,
    ProjectRoot=sp_project.ProjectRoot,
    Run=Button(),
    ReplaceExisting=Toggle(True),
    ShowTerminal=Toggle(True),
    ExtractFeatures=Toggle(True),
    MatchFeatures=Toggle(True),
    ReconstructSparse=Toggle(True),
    UndistortImages=Toggle(False),
    ExportTextModel=Toggle(True),
    ShowProgress=Toggle(True),
    Cancel=Button())  # -> ActiveDataset, ExitCode, Log, Status, Progress
panel_10 = Panel(sp_colmap_all.Status)

# ---- group: Only pass one result to next step!
merge = Merge(Data1=sp_export.ActiveDataset, Data2=sp_colmap_all.ActiveDataset)
clean = CleanTree(RemoveNulls=True, RemoveInvalid=True, RemoveEmpty=True, Tree=merge)

# ---- group: Model preview
sp_sparse_cloud = SPSparsePointCloud(
    TextModelFolder=clean,
    MaximumPoints=0,
    LastTextModelFolder="F:\ETH\Vorlesungen\Master\compas_3DGS\example\test_undistort\colmap\sparse-text")  # -> PointCloud, LoadedPoints, Status
sp_cameras = SPCameraPlanes(
    TextModelFolder=clean,
    PlaneHeight=1,
    MaximumCameras=0,
    LastTextModelFolder="F:\ETH\Vorlesungen\Master\compas_3DGS\example\test_undistort\colmap\sparse-text")  # -> CameraPlanes, CameraCentres, ImageNames, Status

# ---- group: Geometry Translator / Get center point from the frames
cluster = Cluster(pt=sp_cameras.CameraCentres)

# ---- group: Geometry Translator
merge_2 = Merge(Data1=sp_sparse_cloud.PointCloud, Data2=sp_cameras.CameraPlanes)  # -> simplify(Result)
movey = Slider(0, range=-100..100)
movex = Slider(0, range=-100..100)
movez = Slider(0, range=-100..100)
degreex = Slider(0, range=0..360)
degreey = Slider(0, range=0..360)
degreez = Slider(0, range=0..360)
scalefactor = Slider(1, range=0.01..50)
pt = Point(cluster)
geo = Geometry(merge_2)
sp_translator = SPGeometryTranslator(
    CentrePoint=pt,
    Geometry=geo,
    MoveX=movex,
    MoveY=movey,
    MoveZ=movez,
    RotateX=degreex,
    RotateY=degreey,
    RotateZ=degreez,
    ScaleFactor=scalefactor)  # -> Geometry, Transforms

# ----
dam = DataDam(DataA=sp_translator.Transforms, BufferDelay=10000000, BufferMode=0)
sp_align_model = SPAlignCOLMAPModel(COLMAPExecutable=sp_download_tools.COLMAP, ActiveDataset=sp_project.ProjectRoot, Transforms=dam, Write=Button())  # -> AlignedTextModel, AlignedSparseModel, Log, Status

# ---- group: result preview
sp_sparse_cloud_2 = SPSparsePointCloud(
    TextModelFolder=sp_align_model.AlignedTextModel,
    MaximumPoints=100000,
    LastTextModelFolder="F:\ETH\Vorlesungen\Master\compas_3DGS\example\test_undistort\colmap\aligned\sparse-text")  # -> PointCloud, LoadedPoints, Status
sp_cameras_2 = SPCameraPlanes(
    TextModelFolder=sp_align_model.AlignedTextModel,
    PlaneHeight=1,
    MaximumCameras=0,
    LastTextModelFolder="F:\ETH\Vorlesungen\Master\compas_3DGS\example\test_undistort\colmap\aligned\sparse-text")  # -> CameraPlanes, CameraCentres, ImageNames, Status

# ----
# DATASET LOGIC
# 
# Each project has one active BASE DATASET.
# Undistortion replaces its images and camera model together.
# Realignment creates a separate aligned model.
# It works with either the original or undistorted base dataset.
# 05 Training
# DATASET CHECK — OPTIONAL, RECOMMENDED
# After sparse reconstruction and text export, click Update.
# Check Valid and read Status.
# This check examines the original project reconstruction.
# It does not validate an aligned or undistorted alternative.
# 
# CHOOSE ONE DATASET SOURCE — REQUIRED
# 
# TO TRAIN THE BASE MODEL
# Leave SP Brush Dataset → Sparse Model Override empty.
# The original or undistorted base model is used automatically.
# 
# TO TRAIN THE ALIGNED MODEL
# Connect SP Align COLMAP Model → Aligned Sparse Model
# to SP Brush Dataset → Sparse Model Override.
# 
# PREPARE DATASET — REQUIRED
# Connect Project Root and choose the dataset source.
# Set Prepare = True.
# Check that Status confirms successful preparation.
# Connect Dataset to Brush Train → Dataset.
# Prepare again after changing the source model.
# 
# TRAIN — REQUIRED
# Connect the Brush executable, Dataset and Project Root.
# Set a job Name and the number of Steps.
# Activate Run once and wait for successful completion.
# Export gives the folder containing the saved PLY files.
button_2 = Button()
sp_dataset = SPActiveDataset(ProjectRoot=sp_project.ProjectRoot, Update=button_2)  # -> ActiveDataset, Valid, SourceImages, RegisteredImages, SparsePoints, Status
sp_brush_data = SPBrushDataset(ActiveDataset=sp_project.ProjectRoot, Prepare=Toggle(False), SparseModelOverride=sp_align_model.AlignedSparseModel)  # -> BrushDataset, Status
sp_brush_train = SPBrushTrain(
    BrushExecutable=sp_download_tools.Brush,
    BrushDataset=sp_brush_data.BrushDataset,
    ProjectRoot=sp_project.ProjectRoot,
    JobName="brush",
    TotalSteps=Slider(30000, range=5000..30000),
    OpenBrushViewer=Toggle(True),
    Run=Button(),
    ReplaceExisting=Toggle(True),
    ShowTerminal=Toggle(True),
    RotateForVisualization=Toggle(True),
    Cancel=Button())  # -> ExportFolder, ExitCode, Log, Status
panel_11 = Panel(sp_brush_data.BrushDataset)
panel_12 = Panel(sp_dataset.Status)
panel_13 = Panel(sp_brush_train.Status)

# ----
# 06 Preview
# 06 PREVIEW — OPTIONAL
# 
# Select an exported Brush PLY and connect it to Splat Preview.
# Enable component preview to view the result in Rhino.
# Reduce Max for faster viewport navigation.
# This component displays a coloured point-cloud preview
# and preserves the PLY’s coordinates.
# 
# For full Gaussian splatting visualization in Rhino on Windows,
# install RhinoGaussianSplatting or Krill and import the exported PLY.
# These plugins render the Gaussian splats with their transparency
# and appearance. They are separate installations from Splatypus.
# 
# For Splat Preview, use the original Brush PLY.
# For RhinoGaussianSplatting and Krill, enable Rotate for Visualization
# during training and use the additional _rgs.ply.
path_2 = FilePath()
sp_splat_preview = SPSplatPreview(BrushPLY=path_2, MaximumSplats="2000000")  # -> PreviewCloud, LoadedSplats, Status
panel_14 = Panel(sp_splat_preview.Status)

# ----
# 02 Dataset
# FFMPEG CHECK — OPTIONAL
# Use FFmpeg Setup to validate the executable.
# Valid = True confirms that FFmpeg can be used.
# 
# MEDIA IMPORT — REQUIRED UNLESS IMAGES ARE ALREADY PREPARED
# Connect FFmpeg, Project Root and your media sources.
# Sources may be videos, image files or folders.
# For videos, set FPS to control the number of extracted frames.
# Still images produce one JPEG per image.
# Check Estimate, then click Run.
# Recommended number of images: 300 to 600
# 
# Wait until the import completes successfully.
path_3 = FilePath()
path_4 = FilePath()  # disabled
# CONTROLS
# Button: click once.
# Toggle: double-click to switch between False and True.
# Run starts when its input changes from False to True.
# Before running again, reset Run to False.
# Wait for successful completion before starting the next operation.
# Read Status for progress, results and errors.
sp_ffmpeg = SPFFmpegSetup(FFmpegExecutable=sp_download_tools.FFmpeg)  # -> Valid, FFmpeg, DecoderCommand, Status

# ---- group: video, images or media folder
add = Merge(Data1=path_3, Data2=path_4)

# ----
sp_media_import = SPMediaImport(
    FFmpegExecutable=sp_download_tools.FFmpeg,
    ProjectRoot=sp_project.ProjectRoot,
    MediaSources=add,
    VideoFramesPerSecond=Slider(5, range=0.1..30),
    Run=Button(),
    ReplacePreviousImport=Toggle(True),
    ShowTerminal=Toggle(True),
    Cancel=Button())  # -> ImagesFolder, ImportedJPEGs, ImageCount, Log, Status, EstimatedJPEGs, ProbeStatus
panel_15 = Panel(sp_media_import.ImageCount)
panel_16 = Panel(sp_media_import.EstimatedJPEGs)
panel_17 = Panel(sp_media_import.ImagesFolder)
panel_18 = Panel(sp_media_import.Status)
panel_19 = Panel(sp_media_import.ProbeStatus)

# ==== cluster Cluster
pt = ClusterInput()
pt_2 = Point(pt)
ma = MassAddition(Input=pt_2)  # -> Result, PartialResults
lng = ListLength(List=pt_2)
division = Division(A=ma.Result, B=lng)
R = ClusterOutput(division)
